# Grasshopper definition Example Structural Engineering Workflow.gh (Grasshopper 1.0.7)
# plug-ins: TaskHopperGH

testuserobj = CertainTypeOfTask(
    tColor=RGB(145, 145, 145),
    tDescription="Revit model of architects design",
    tHasDate=False,
    tLink="C:\Users\Dominic\source\repos\Taskhopper\TaskHopperGH\Images",
    tName="Architects BIM model",
    tOwner="BIM Technician",
    tStatus=4,
    tTags_ListItem=["Source", "Revit"])
testuserobj_2 = CertainTypeOfTask(
    port=testuserobj,
    tColor=RGB(48, 145, 186),
    tDescription="Revit template with necessary levels, sheets, etc setup to later be populated ",
    tHasDate=False,
    tLink="C:\Users\Dominic\source\repos\Taskhopper\TaskHopperGH\Images",
    tName="Revit Template",
    tOwner="BIM Technician",
    tStatus=4,
    tTags_ListItem=["Revit", "Manual"])
testuserobj_3 = CertainTypeOfTask(
    port=testuserobj,
    tColor=RGB(115, 171, 46),
    tDescription="""Grasshopper script that extracts key geometry data from Architects bim model. Exported as GH Data
- Slab edge/void curves
- Column centre line curves and orientation
- Core wall base curves
- Cladding envelope as surfaces
- Levels as planes
- Gridlines as planes""",
    tHasDate=False,
    tLink="\\Clodfsglo19-21k\1021000$\1021392 - Media Surface - Stage One\Cundall Docs\Calculations\Structural\Global models\Connections\27_Holoplot Update\Extraction",
    tName="Pull geometry from BIM",
    tOwner="BIM Technician",
    tStatus=4,
    tTags_ListItem=["Grasshopper", "RhinoInRevit", "GH Data", "Auto"])
testuserobj_4 = CertainTypeOfTask(
    tColor=RGB(115, 171, 46),
    tDescription="Script containing all key global parameters used in the project. Exported as GH Data. Do not edit without permission from owner.",
    tHasDate=False,
    tLink="www.google.com",
    tName="Global Parameters",
    tOwner="Senior Engineer",
    tStatus=4,
    tTags_ListItem=["Grasshopper", "GH Data", "Auto"])
testuserobj_5 = CertainTypeOfTask(
    port=testuserobj_4,
    tColor=RGB(115, 171, 46),
    tHasDate=False,
    tLink="C:\Users\Dominic\source\repos\Taskhopper\TaskHopperGH\Images",
    tName="Generate complex geometry",
    tOwner="Senior Engineer",
    tStatus=4,
    tTags_ListItem=["Grasshopper", "Holoplots", "Auto"])
testuserobj_6 = CertainTypeOfTask(
    port=[testuserobj_4, testuserobj_3, testuserobj_5],
    tColor=RGB(115, 171, 46),
    tDescription="Script building a master model of the structural elements that is then used as source for both structural analysis model and Revit model",
    tHasDate=False,
    tLink="C:\Users\Dominic\source\repos\Taskhopper\TaskHopperGH\Images",
    tName="Build master model",
    tOwner="Senior Engineer",
    tStatus=4,
    tTags_ListItem=["Grasshopper", "Auto"])
testuserobj_7 = CertainTypeOfTask(
    port=testuserobj_6,
    tColor=RGB(115, 171, 46),
    tDescription="Build structural model using GeometryGym in Grasshopper",
    tHasDate=False,
    tLink="C:\Users\Dominic\source\repos\Taskhopper\TaskHopperGH\Images",
    tName="Build Robot Model",
    tOwner="Junior Engineer",
    tStatus=3,
    tTags_ListItem=["Grasshopper", "Robot", "GeometryGym", "Auto"])
testuserobj_8 = CertainTypeOfTask(
    port=testuserobj_7,
    tColor=RGB(199, 169, 48),
    tDescription="Analysis model, based on gh export. A few manual tweaks to the generated model need to be performed before running the analysis",
    tHasDate=False,
    tLink="C:\Users\Dominic\source\repos\Taskhopper\TaskHopperGH\Images",
    tName="Structural Analysis Model",
    tOwner="Senior Engineer",
    tStatus=2,
    tTags_ListItem=["Robot", "Semi Auto"])
testuserobj_9 = CertainTypeOfTask(
    port=testuserobj_8,
    tColor=RGB(230, 0, 0),
    tDescription="Complex hand verification for some special case members",
    tHasDate=False,
    tLink="C:\Users\Dominic\source\repos\Taskhopper\TaskHopperGH\Images",
    tName="By Hand Member Verification",
    tOwner="Mid Engineer",
    tStatus=2,
    tTags_ListItem="Manual")
testuserobj_10 = CertainTypeOfTask(
    port=testuserobj_8,
    tColor=RGB(199, 169, 48),
    tDescription="Verify suitable members using automated method in Robot",
    tHasDate=False,
    tLink="C:\Users\Dominic\source\repos\Taskhopper\TaskHopperGH\Images",
    tName="Structural Member Verification",
    tOwner="Senior Engineer",
    tStatus=1,
    tTags_ListItem=["Robot", "Auto"])
relay = Relay([testuserobj_10, testuserobj_9])
testuserobj_11 = CertainTypeOfTask(
    port=[relay, testuserobj_6],
    tColor=RGB(115, 171, 46),
    tDescription="Section sizes in the master model are updated based on verified member sizes",
    tHasDate=False,
    tLink="C:\Users\Dominic\source\repos\Taskhopper\TaskHopperGH\Images",
    tName="Update section sizes",
    tOwner="Senior Engineer",
    tStatus=4,
    tTags_ListItem=["Grasshopper", "Semi Auto"])
testuserobj_12 = CertainTypeOfTask(
    port=relay,
    tColor=RGB(0, 38, 191),
    tDescription="Analysis report",
    tHasDate=False,
    tLink="google.com",
    tName="Report",
    tOwner="The Boss",
    tStatus=1,
    tTags_ListItem=["Report", "Word Doc", "Deliverable", "Manual"])
testuserobj_13 = CertainTypeOfTask(
    port=[testuserobj_2, testuserobj_11],
    tColor=RGB(115, 171, 46),
    tDescription="Create structural model using Rhino Inside Revit",
    tHasDate=False,
    tLink="C:\Users\Dominic\source\repos\Taskhopper\TaskHopperGH\Images",
    tName="Build Revit Model",
    tOwner="Junior Engineer",
    tStatus=4,
    tTags_ListItem=["Grasshopper", "RhinoInRevit", "Auto"])
testuserobj_14 = CertainTypeOfTask(
    port=testuserobj_13,
    tColor=RGB(48, 145, 186),
    tDescription="Final Revit model with all drawings generated and checked",
    tHasDate=False,
    tLink="C:\Users\Dominic\source\repos\Taskhopper\TaskHopperGH\Images",
    tName="Revit Model w/ Drawings",
    tOwner="BIM Technician",
    tStatus=4,
    tTags_ListItem=["Revit", "Deliverable", "Semi Auto"])
